# Grasshopper definition 230226_Simple_COMPAS_RRC_SE_edSEDJ.gh (Grasshopper 1.0.7)

robot_name = ValueList({"abb_irb4600_60_205", "abb_crb_15000"}, selected="abb_crb_15000")
py = GhPythonScript()  # -> urdf_source
# ---------- py: Python ----------
import os
import sys

filepath = ghenv.Component.Attributes.Owner.OnPingDocument().FilePath
path = os.path.abspath(os.path.join(filepath, "..", ".."))
print(path)

urdf_source = os.path.abspath(os.path.join(path, "robot_description"))
# ---------- end py ----------
# Load Robot from urdf
panel = Panel(py)
disconnect = Button()
list = ValueList({"simulation": 0, "real_robot": 1}, selected="real_robot")
connect = Button()
# This grasshopper definition is adapted from the Robotic Plaster Spraying, Gramazio Kohler Research:
# github.com/gramaziokohler/robotic_plaster_spraying
# 
# Credits: Selen Ercan Jenny, Nicolas Feihl, et al.
# ROS Connection
restart = Button()
ros = PythonScript(restart=restart, ip=list)  # -> ros_client
# ---------- ros: Python ----------
import time
import logging
import scriptcontext as sc

from compas_fab.backends import RosClient
from System import TimeSpan
from System.Threading import ManualResetEventSlim


LOGGER = logging.getLogger('roslibpy')

guid = str(ghenv.Component.InstanceGuid)
ros_client_key = "rosclient_" + guid

previous_client = sc.sticky.get(ros_client_key, None)
if previous_client:
    previous_client.terminate()

if ip == 0: #local
    ros_client = RosClient('127.0.0.1', 9090) #local, own laptop
elif ip == 1: #real robot
    ros_client = RosClient('127.0.0.1', 9090) #place holder

waitLock = ManualResetEventSlim(False)
ros_client.on_ready(lambda: waitLock.Set())

if not waitLock.Wait(TimeSpan.FromSeconds(5)):
    raise Exception('Unable to connect to ROS')

LOGGER.info('Connected to ROS')
# ---------- end ros ----------
connect_2 = PythonScript(ros_client=ros, connect=connect, disconnect=disconnect)  # -> out, ros_client
# ---------- connect_2: Python ----------
import logging
from System import TimeSpan
from System.Threading import ManualResetEventSlim

LOGGER = logging.getLogger('roslibpy')

if connect:
    if not ros_client.is_connected:
        LOGGER.debug('Connecting...')
        waitLock = ManualResetEventSlim(False)
        ros_client.on_ready(lambda: waitLock.Set())
        ros_client.connect()

        if not waitLock.Wait(TimeSpan.FromSeconds(5)):
            raise Exception('Unable to connect to ROS')
        LOGGER.debug('Reconnected')

if disconnect:
    if ros_client.is_connected:
        ros_client.terminate()
        LOGGER.debug('Terminated')
# ---------- end connect_2 ----------
path = PythonScript(path=panel, robot_name=robot_name)  # -> urdf_source
# ---------- path: Python ----------
import os

urdf_source = os.path.join(os.path.abspath(path), robot_name)

assert(os.path.isdir(urdf_source))
# ---------- end path ----------
units = ValueList({"m": 1, "mm": 1000}, selected="mm")
load = BooleanToggle(False)
robot = PythonScript(urdf_source=path, ros_client=connect_2.ros_client, scale_factor=units, load=load)  # -> out, robot
# ---------- robot: Python ----------
import os
from scriptcontext import sticky as st
import compas


from compas.robots import RobotModel
from compas.robots import LocalPackageMeshLoader
from compas_fab.ghpython import RobotArtist

from compas_fab.robots import Robot as Robot
from compas_fab.backends import RosClient


# Set high precision to import meshes defined in meters
compas.PRECISION = '12f'

# store data in component
guid = str(ghenv.Component.InstanceGuid)
robot_key = "robot_" + guid


if robot_key not in st:
    st[robot_key] = None


if load == True:
    
    model = RobotModel.from_urdf_file(os.path.join(urdf_source, 'robot_description.urdf'))
    model.load_geometry(LocalPackageMeshLoader(urdf_source, 'robot_description'))
    artist = RobotArtist(model)
    robot = Robot(model, artist, semantics = None)
    
    robot.scale(scale_factor)
    st[robot_key] = robot

robot = st[robot_key]

if robot:
    robot.client = ros_client
# ---------- end robot ----------
geo = Geometry(<point referenced from the Rhino model>)
geo_2 = Geometry(<point referenced from the Rhino model>)
j1 = Slider(34, range=-360..360)
j2 = Slider(4, range=-360..360)
j3 = Slider(-18, range=-360..360)
j5 = Slider(124, range=-360..360)
j6 = Slider(31, range=-360..360)
j4 = Slider(-116, range=-360..360)
pdecon = Deconstruct(Point=geo_2)  # -> XComponent, YComponent, ZComponent
x = Number(pdecon.XComponent)
y = Number(pdecon.YComponent)
z = Number(pdecon.ZComponent)
state = ValueList({"forward_kinematics": 0, "robot_state": 1}, selected="robot_state")
custom_instruction_get_vacuum = GhPythonScript(send=Button())  # -> out, a; inputs send: Boolean
# ---------- custom_instruction_get_vacuum: Python ----------
import compas_rrc as rrc

if send:
    # Create Ros Client
    ros = rrc.RosClient()
    ros.run()

    # Create ABB Client
    abb = rrc.AbbClient(ros, '/rob1')
    print('Connected.')

    # Custom instruction name (RAPID Procedure name)
    # Implemented instructions:
    # 'r_WS_MoveToHome'
    # 'r_WS_MoveToZero'
    # 'r_WS_GetVacuum'
    # 'r_WS_PlaceVacuum'
    # 'r_WS_OpenVacuumGripper'
    # 'r_WS_CloseVacuumGripper'
    # 'r_WS_PickShingleVacuum'

    instruction = 'r_WS_GetVacuum'


    # string vlaue list of 8 strings
    string_values = []

    # float value list of 36 floats
    float_values = []

    # Custom instruction
    done = abb.send_and_wait(rrc.CustomInstruction(instruction, string_values, float_values))
    # Set tool
    # done = abb.send_and_wait(rrc.SetTool('tVacuumSchmalz'))

    # Print feedback
    print('Feedback = ', done)

    # End of Code
    print('Finished')

    # Close client
    ros.close()
    ros.terminate()
# ---------- end custom_instruction_get_vacuum ----------
button = Button()

send_frame = Button()
x_2 = Number(expr("x*1000", pdecon.XComponent))
y_2 = Number(expr("x*1000", pdecon.YComponent))
z_2 = Number(expr("x*1000", pdecon.ZComponent))
connect_3 = BooleanToggle(False)
compas_rrc = GhPythonScript(robot_name=robot_name, send=send_frame, x_coor=x, y_coor=y, z_coor=z)  # -> out; inputs x_coor: list, y_coor: list, z_coor: list
# ---------- compas_rrc: Python ----------
################################################################################
#### IMPORTS ###################################################################
from __future__ import absolute_import, division, print_function

import Rhino.Geometry as rg

from compas.geometry import Frame, Point, Vector
from compas_fab.backends.ros import RosClient
from compas_rrc import AbbClient, GetFrame, Motion, MoveToFrame, PrintText, SetAcceleration, SetMaxSpeed, SetWorkObject, SetTool, Zone
#### END OF IMPORTS ############################################################
################################################################################


################################################################################
##### GLOBALS ##################################################################
TIMEOUT         =    5  #[s]    avoid freezing the main thread forever in case controller (virtual or real) is not available.
TIMEOUT_LONG    =   30  #[s]    avoid freezing the main thread forever, for time consuming processes (slow motions)

##### END OF GLOBALS ###########################################################
################################################################################

target_frame = []
for x, y, z in zip(x_coor, y_coor, z_coor):
    # target_frame.append(Frame(Point(x, y, z), Vector(0.000, 0.000, -1.000), Vector(0.000, 1.000, 0.000)))
    target_frame.append(Frame(Point(x, y, z), Vector(-1.000, 0.000, 0.000), Vector(0.000, 1.000, 0.000)))

target_frame_name = "target_frame"

if target_frame is not None and robot_name == "abb_irb4600_60_205" or "abb_crb_15000":
    if send:
        # Create Ros Client
        ros = RosClient()
        print(ros.is_connected)
        ros.run() # new
        
        # Create ABB Client
        abb = AbbClient(ros)
        #abb.run(timeout=TIMEOUT)        #old
        print(ros.is_connected)
        print('Connected.')
        
        # Set the correct Tool TCP and Set Work Object
        """ for safe operation --avoiding mistakes-- define the properties of the tool
        in RAPID and only call/set which tool to use here."""
        if robot_name == "abb_irb4600_60_205":
            done = abb.send_and_wait(SetTool("t_RRC_Tool_Z"), timeout=TIMEOUT)
            abb.send(SetWorkObject("ob_RRC_Workplace"))
        elif robot_name == "abb_crb_15000":
            done = abb.send_and_wait(SetTool("tool0"), timeout=TIMEOUT)
            abb.send(SetWorkObject("wobj0"))
            
        #elif robot_name == "abb_crb_15000":
        #    done = abb.send_and_wait(SetTool("t_RRC_Act"), timeout=TIMEOUT)
        #    abb.send(SetWorkObject("ob_RRC_Act"))
        
        # Set Acceleration
        acc =  100 # Unit [%]
        ramp = 100 # Unit [%]
        done = abb.send_and_wait(SetAcceleration(acc, ramp), timeout=TIMEOUT)
        
        # Set Max Speed
        override = 100 # Unit [%]
        max_tcp =  500 # Unit [mm/s]
        done = abb.send_and_wait(SetMaxSpeed(override, max_tcp), timeout=TIMEOUT)
        
        # Display action sent on the TeachPendant 
        pendant_message = "Moving to position on {target_frame_name}".format(target_frame_name = target_frame_name)
        done = abb.send_and_wait(PrintText(pendant_message))
        
        # Move to Frame
        for frame in target_frame:
            current_frame = abb.send_and_wait(MoveToFrame(frame, 200, Zone.FINE, Motion.LINEAR), timeout=TIMEOUT_LONG)
            print(current_frame)
        
        # Close client
        # abb.close() # old
        # abb.terminate() # old
        ros.close() # new
        ros.terminate() # new
        
        # End of Code
        print('Finished')
        
    else:
        print("No motion command sent")
# ---------- end compas_rrc ----------
compas_rrc_2 = GhPythonScript(robot_name=robot_name, connect=connect_3, refresh=button)  # -> out; inputs refresh: Boolean
# ---------- compas_rrc_2: Python ----------
################################################################################
#### IMPORTS ###################################################################
from __future__ import absolute_import, division, print_function

import Rhino.Geometry as rg

from compas.geometry import Frame, Point
from compas_fab.backends.ros import RosClient
from compas_rrc import AbbClient, GetJoints
#### END OF IMPORTS ############################################################
################################################################################


################################################################################
##### GLOBALS ##################################################################
TIMEOUT         =    5  #[s]    avoid freezing the main thread forever in case controller (virtual or real) is not available.
TIMEOUT_LONG    =   30  #[s]    avoid freezing the main thread forever, for time consuming processes (slow motions)

##### END OF GLOBALS ###########################################################
################################################################################

import scriptcontext as sc

if robot_name == "abb_irb4600_60_205" or "abb_crb_15000":
    if connect:
        # Create Ros Client
        ros = RosClient()
        print(ros.is_connected)
        ros.run() # new
        
        # Create ABB Client
        abb = AbbClient(ros)
        #abb.run(timeout=TIMEOUT)        #old
        print(ros.is_connected)
        print('Connected.')
        
        # Get joints states
        
        # joint_states = abb.send_and_wait(GetJoints(feedback_level=1), timeout=TIMEOUT_LONG) # old
        joint_states = abb.send_and_wait(GetJoints(), timeout=TIMEOUT_LONG) #new
        
        sc.sticky['abb_state'] = joint_states
        message_abb_state = sc.sticky['abb_state']
        
        print (message_abb_state[0])
        
        # Close client
        # abb.close() # old
        # abb.terminate() # old
        ros.close() # new
        ros.terminate() # new
        
        
        # End of Code
        print('Finished')
# ---------- end compas_rrc_2 ----------

custom_instruction_placevacuum = GhPythonScript(send=Button())  # -> out, a; inputs send: Boolean
# ---------- custom_instruction_placevacuum: Python ----------
import compas_rrc as rrc

if send:
    # Create Ros Client
    ros = rrc.RosClient()
    ros.run()

    # Create ABB Client
    abb = rrc.AbbClient(ros, '/rob1')
    print('Connected.')

    # Custom instruction name (RAPID Procedure name)
    # Implemented instructions:
    # 'r_WS_MoveToHome'
    # 'r_WS_MoveToZero'
    # 'r_WS_GetVacuum'
    # 'r_WS_PlaceVacuum'
    # 'r_WS_OpenVacuumGripper'
    # 'r_WS_CloseVacuumGripper'
    # 'r_WS_PickShingleVacuum'

    instruction = 'r_WS_PlaceVacuum'


    # string vlaue list of 8 strings
    string_values = []

    # float value list of 36 floats
    float_values = []

    # Custom instruction
    done = abb.send_and_wait(rrc.CustomInstruction(instruction, string_values, float_values))
    # Set tool
    # done = abb.send_and_wait(rrc.SetTool('tVacuumSchmalz'))

    # Print feedback
    print('Feedback = ', done)

    # End of Code
    print('Finished')

    # Close client
    ros.close()
    ros.terminate()
# ---------- end custom_instruction_placevacuum ----------
forward_kinematics = PythonScript(robot=robot.robot, j1=j1, j2=j2, j3=j3, j4=j4, j5=j5, j6=j6)  # -> configuration
# ---------- forward_kinematics: Python ----------
import math
from compas_fab.robots import Configuration

if robot:
    configuration = [j1, j2, j3, j4, j5, j6]
    configuration = [math.radians(a) for a in configuration]
# ---------- end forward_kinematics ----------
show_end_effector_frame = BooleanToggle(False)
panel_2 = Panel(compas_rrc)
show_visual = BooleanToggle(True)
show_axes = BooleanToggle(True)
panel_3 = Panel(compas_rrc_2)
visualize = PythonScript(
    robot_name=robot_name,
    robot=robot.robot,
    mode=state,
    configuration=forward_kinematics,
    robot_2=robot.robot,
    show_visual=show_visual,
    show_axes=show_axes,
    show_end_effector_frame=show_end_effector_frame,
    refresh=button)  # -> visual, axes, axes_color, ee_frame_vis, ee_color; inputs configuration: list, refresh: Boolean
# ---------- visualize: Python ----------
from System.Drawing import Color
from compas_ghpython.utilities import draw_frame
from compas_ghpython.utilities import draw_pipes
from compas_fab.robots import Configuration

from compas.geometry import Point
from compas.geometry import Vector

import scriptcontext as sc
import math as m

frames = []

size = .100
size_w = 1
radius = .001 
radius_w = .009 

red = Color.FromArgb(255, 0, 0)
green = Color.FromArgb(0, 255, 0)
blue = Color.FromArgb(0, 0, 255)

frame_colors = [red, green, blue]


def pipes_from_frame(frame, size, radius): 
    pipes = []
    for axis in [frame.xaxis, frame.yaxis, frame.zaxis]:
        pipe = {}
        pipe['points'] = [list(frame.point), list(Point(*frame.point) + Vector(*axis) * size)]
        pipe['radius'] = radius
        pipes.append(pipe)
    return pipes



if robot and len(configuration):
    if mode == 0: #forward_kinematics
        #print configuration
        configuration = Configuration.from_revolute_values(configuration)

    elif mode == 1: #robot_state

        joint_names = []
        joint_positions = []

        if robot_name == "abb_irb4600_60_205" or "abb_crb_15000":
            message_abb_state = sc.sticky['abb_state']
            print sc.sticky
            for reading in range(6):
                joint_positions.append(m.radians(message_abb_state[0][reading]))

        configuration = Configuration.from_revolute_values(joint_positions)
        
    print ('Setting robot configuration:')
    print (configuration)
    
    robot.update(configuration, visual=True, collision=False)
    
    if show_visual:
        visual = robot.artist.draw_visual()

    if show_axes:
        pipes = []
        axes_color = []
        for frame in robot.transformed_frames(configuration):
            pipes += pipes_from_frame(frame, size, radius)
            axes_color += frame_colors
        axes = draw_pipes(pipes, cap=1)
    
    
    if show_end_effector_frame:
        ee_frame = robot.forward_kinematics(configuration)
        print("End-effector", ee_frame)
        
        #Draw
        ee_pipes = pipes_from_frame(ee_frame, size, radius)
        ee_frame_vis = draw_pipes(ee_pipes, cap=1)
        ee_color = frame_colors
# ---------- end visualize ----------
geo_3 = Geometry(visualize.visual)
preview = CustomPreview(Geometry=visualize.ee_frame_vis, Shader=visualize.ee_color)
preview_2 = CustomPreview(Geometry=visualize.axes, Shader=visualize.axes_color)
