# Grasshopper definition 230316_Simple_COMPAS_RRC_SE_edSEDJ.gh (Grasshopper 1.0.7)

# ---- group: shift
height_1 = Slider(4, range=0..1000)
height_2 = Slider(2, range=0..1000)
z_offset = Slider(5, range=0..50)
size_y = Slider(500, range=0..1000)
size_y_2 = Slider(150, range=0..1000)
size_x = Slider(400, range=0..1000)
size_x_2 = Slider(60, range=0..1000)
geo = Geometry(<point referenced from the Rhino model>)
xy = XYPlane(Origin=geo)
design = GhPythonScript(z_offset=z_offset, o_plane=xy, w_x=size_x, w_y=size_y, s_x=size_x_2, s_y=size_y_2, h_1=height_1, h_2=height_2)  # -> out, temp_geom, place_planes, place_planes_flat; inputs o_plane: Plane
# ---------- design: Python ----------
"""
"""

__author__ = "jend"
__version__ = "2023.03.14"

import Rhino.Geometry as rg
import math as m

temp_geom = []

pt_1 = o_plane.Origin - s_y * 0.5 * o_plane.YAxis + h_1 * o_plane.ZAxis
pt_2 = o_plane.Origin + s_y * 0.5 * o_plane.YAxis + h_2 * o_plane.ZAxis

temp_line = rg.Line(pt_1,pt_2)
temp_vec = pt_2 - pt_1
temp_geom.extend([pt_1,pt_2,temp_line])


inclined_plane = rg.Plane(temp_line.PointAt(0.5), o_plane.XAxis, temp_vec)


shift = s_y / 3
no_x = int(m.floor(w_x / s_x))
no_y = int(m.floor(w_y / shift))
actual_shift = w_y / no_y
print shift, actual_shift

place_planes = []
place_planes_flat = []
for i in range(no_y):
    for j in range(no_x):
        o_pt = o_plane.Origin + o_plane.XAxis * ((s_x * j) + s_x/2) + o_plane.YAxis * ((actual_shift * i) +s_y/2)
        temp_geom.append(o_pt)
        temp_plane = rg.Plane(inclined_plane)
        temp_plane.Origin = o_pt + rg.Vector3d.ZAxis * z_offset
        temp_plane = rg.Plane(temp_plane.Origin, -temp_plane.XAxis, temp_plane.YAxis)
        temp_plane.Translate(rg.Vector3d.YAxis * j * 5)
        place_planes.append(temp_plane)
        print type(temp_plane)
        
        place_plane_flat = rg.Plane(o_pt + rg.Vector3d.ZAxis * z_offset, -rg.Vector3d.XAxis, rg.Vector3d.YAxis)
        place_plane_flat.Translate(rg.Vector3d.YAxis * j * 5)
        place_planes_flat.append(place_plane_flat)
# ---------- end design ----------
geo_2 = Geometry(design.place_planes)
geo_3 = Geometry(design.place_planes_flat)

# ---- group: straight
height_1_2 = Slider(4, range=0..1000)
height_2_2 = Slider(2, range=0..1000)
z_offset_2 = Slider(5, range=0..50)
size_y_3 = Slider(500, range=0..1000)
size_y_4 = Slider(150, range=0..1000)
size_x_3 = Slider(400, range=0..1000)
size_x_4 = Slider(60, range=0..1000)
geo_4 = Geometry(<point referenced from the Rhino model>)
xy_2 = XYPlane(Origin=geo_4)
design_2 = GhPythonScript(
    z_offset=z_offset_2,
    o_plane=xy_2,
    w_x=size_x_3,
    w_y=size_y_3,
    s_x=size_x_4,
    s_y=size_y_4,
    h_1=height_1_2,
    h_2=height_2_2)  # -> out, temp_geom, place_planes, place_planes_flat; inputs o_plane: Plane
# ---------- design_2: Python ----------
"""
"""

__author__ = "jend"
__version__ = "2023.03.14"

import Rhino.Geometry as rg
import math as m

temp_geom = []

pt_1 = o_plane.Origin - s_y * 0.5 * o_plane.YAxis + h_1 * o_plane.ZAxis
pt_2 = o_plane.Origin + s_y * 0.5 * o_plane.YAxis + h_2 * o_plane.ZAxis

temp_line = rg.Line(pt_1,pt_2)
temp_vec = pt_2 - pt_1
temp_geom.extend([pt_1,pt_2,temp_line])


inclined_plane = rg.Plane(temp_line.PointAt(0.5), o_plane.XAxis, temp_vec)


shift = s_y / 3
no_x = int(m.floor(w_x / s_x))
no_y = int(m.floor(w_y / shift))
actual_shift = w_y / no_y
print shift, actual_shift

place_planes = []
place_planes_flat = []
for i in range(no_y):
    for j in range(no_x):
        o_pt = o_plane.Origin + o_plane.XAxis * ((s_x * j) + s_x/2) + o_plane.YAxis * ((actual_shift * i) +s_y/2)
        temp_geom.append(o_pt)
        temp_plane = rg.Plane(inclined_plane)
        temp_plane.Origin = o_pt + rg.Vector3d.ZAxis * z_offset
        temp_plane.XAxis = -temp_plane.XAxis
        place_planes.append(temp_plane)
        
        place_plane_flat = rg.Plane(o_pt + rg.Vector3d.ZAxis * z_offset, -rg.Vector3d.XAxis, rg.Vector3d.YAxis)
        place_planes_flat.append(place_plane_flat)
# ---------- end design_2 ----------
geo_5 = Geometry(design_2.place_planes_flat)
geo_6 = Geometry(design_2.place_planes)

# ---- group: inclined
height_1_3 = Slider(4, range=0..1000)
height_2_3 = Slider(2, range=0..1000)
z_offset_3 = Slider(5, range=0..50)
size_y_5 = Slider(500, range=0..1000)
size_y_6 = Slider(150, range=0..1000)
size_x_5 = Slider(400, range=0..1000)
size_x_6 = Slider(60, range=0..1000)
geo_7 = Geometry(<point referenced from the Rhino model>)
xy_3 = XYPlane(Origin=geo_7)
design_3 = GhPythonScript(
    z_offset=z_offset_3,
    o_plane=xy_3,
    w_x=size_x_5,
    w_y=size_y_5,
    s_x=size_x_6,
    s_y=size_y_6,
    h_1=height_1_3,
    h_2=height_2_3)  # -> out, temp_geom, place_planes, place_planes_flat; inputs o_plane: Plane
# ---------- design_3: Python ----------
"""
"""

__author__ = "jend"
__version__ = "2023.03.14"

import Rhino.Geometry as rg
import math as m

temp_geom = []

pt_1 = o_plane.Origin - s_y * 0.5 * o_plane.YAxis + h_1 * o_plane.ZAxis
pt_2 = o_plane.Origin + s_y * 0.5 * o_plane.YAxis + h_2 * o_plane.ZAxis

temp_line = rg.Line(pt_1,pt_2)
temp_vec = pt_2 - pt_1
temp_geom.extend([pt_1,pt_2,temp_line])


inclined_plane = rg.Plane(temp_line.PointAt(0.5), o_plane.XAxis, temp_vec)


shift = s_y / 3
no_x = int(m.floor(w_x / s_x))
no_y = int(m.floor(w_y / shift))
actual_shift = w_y / no_y
print shift, actual_shift

place_planes = []
place_planes_flat = []
for i in range(no_y):
    for j in range(no_x):
        o_pt = o_plane.Origin + o_plane.XAxis * ((s_x * j) + s_x/2) + o_plane.YAxis * ((actual_shift * i) +s_y/2)
        temp_geom.append(o_pt)
        temp_plane = rg.Plane(inclined_plane)
        temp_plane.Origin = o_pt + rg.Vector3d.ZAxis * z_offset
        temp_plane = rg.Plane(temp_plane.Origin, -temp_plane.XAxis, temp_plane.YAxis)
        temp_plane.Rotate(m.radians(5*i),temp_plane.ZAxis, temp_plane.Origin)
        place_planes.append(temp_plane)
        print type(temp_plane)
        
        place_plane_flat = rg.Plane(o_pt + rg.Vector3d.ZAxis * z_offset, -rg.Vector3d.XAxis, rg.Vector3d.YAxis)
        place_plane_flat.Rotate(m.radians(5*i),place_plane_flat.ZAxis, place_plane_flat.Origin)
        place_planes_flat.append(place_plane_flat)
# ---------- end design_3 ----------
geo_8 = Geometry(design_3.place_planes)
geo_9 = Geometry(design_3.place_planes_flat)

# ----
custom_instruction_placevacuum = GhPythonScript(send=Button())  # -> out, a; inputs send: Boolean
# ---------- custom_instruction_placevacuum: Python ----------
import compas_rrc as rrc

if send:
    # Create Ros Client
    ros = rrc.RosClient()
    ros.run()

    # Create ABB Client
    abb = rrc.AbbClient(ros, '/rob1')
    print('Connected.')

    # Custom instruction name (RAPID Procedure name)
    # Implemented instructions:
    # 'r_WS_MoveToHome'
    # 'r_WS_MoveToZero'
    # 'r_WS_GetVacuum'
    # 'r_WS_PlaceVacuum'
    # 'r_WS_OpenVacuumGripper'
    # 'r_WS_CloseVacuumGripper'
    # 'r_WS_PickShingleVacuum'

    instruction = 'r_WS_PlaceVacuum'


    # string vlaue list of 8 strings
    string_values = []

    # float value list of 36 floats
    float_values = []

    # Custom instruction
    done = abb.send_and_wait(rrc.CustomInstruction(instruction, string_values, float_values))
    # Set tool
    # done = abb.send_and_wait(rrc.SetTool('tVacuumSchmalz'))

    # Print feedback
    print('Feedback = ', done)

    # End of Code
    print('Finished')

    # Close client
    ros.close()
    ros.terminate()
# ---------- end custom_instruction_placevacuum ----------
custom_instruction_get_vacuum = GhPythonScript(send=Button())  # -> out, a; inputs send: Boolean
# ---------- custom_instruction_get_vacuum: Python ----------
import compas_rrc as rrc

if send:
    # Create Ros Client
    ros = rrc.RosClient()
    ros.run()

    # Create ABB Client
    abb = rrc.AbbClient(ros, '/rob1')
    print('Connected.')

    # Custom instruction name (RAPID Procedure name)
    # Implemented instructions:
    # 'r_WS_MoveToHome'
    # 'r_WS_MoveToZero'
    # 'r_WS_GetVacuum'
    # 'r_WS_PlaceVacuum'
    # 'r_WS_OpenVacuumGripper'
    # 'r_WS_CloseVacuumGripper'
    # 'r_WS_PickShingleVacuum'

    instruction = 'r_WS_GetVacuum'


    # string vlaue list of 8 strings
    string_values = []

    # float value list of 36 floats
    float_values = []

    # Custom instruction
    done = abb.send_and_wait(rrc.CustomInstruction(instruction, string_values, float_values))
    # Set tool
    # done = abb.send_and_wait(rrc.SetTool('tVacuumSchmalz'))

    # Print feedback
    print('Feedback = ', done)

    # End of Code
    print('Finished')

    # Close client
    ros.close()
    ros.terminate()
# ---------- end custom_instruction_get_vacuum ----------

robot_name = ValueList({"abb_irb4600_60_205", "abb_crb_15000"}, selected="abb_crb_15000")
py = GhPythonScript()  # -> urdf_source
# ---------- py: Python ----------
import os
import sys

filepath = ghenv.Component.Attributes.Owner.OnPingDocument().FilePath
path = os.path.abspath(os.path.join(filepath, "..", ".."))
print(path)

urdf_source = os.path.abspath(os.path.join(path, "robot_description"))
# ---------- end py ----------
# Load Robot from urdf
panel = Panel(py)
disconnect = Button()
list = ValueList({"simulation": 0, "real_robot": 1}, selected="real_robot")
connect = Button()
# This grasshopper definition is adapted from the Robotic Plaster Spraying, Gramazio Kohler Research:
# github.com/gramaziokohler/robotic_plaster_spraying
# 
# Credits: Selen Ercan Jenny, Nicolas Feihl, et al.
# ROS Connection
restart = Button()
speed_pick_and_place = Slider(50, range=0..100)
speed_safe_positions = Slider(400, range=0..500)
speed_move = Slider(200, range=0..300)
pick_pt_modelled = Geometry(<point referenced from the Rhino model>)

# ---- group: safety_joints
safety_joints = Merge(Data1="-95.0", Data2="0.0", Data3="45.0", Data4="0.0", Data5="45.0", Data6="85.0")

# ---- group: pick_pt
pick_pt = ConstructPoint(XCoordinate="474.34", YCoordinate="74.42", ZCoordinate="3.6")

# ----
Z = UnitZ(Factor=Slider(2.5, range=0..10))
send = Button()
ros = PythonScript(restart=restart, ip=list)  # -> ros_client
# ---------- ros: Python ----------
import time
import logging
import scriptcontext as sc

from compas_fab.backends import RosClient
from System import TimeSpan
from System.Threading import ManualResetEventSlim


LOGGER = logging.getLogger('roslibpy')

guid = str(ghenv.Component.InstanceGuid)
ros_client_key = "rosclient_" + guid

previous_client = sc.sticky.get(ros_client_key, None)
if previous_client:
    previous_client.terminate()

if ip == 0: #local
    ros_client = RosClient('127.0.0.1', 9090) #local, own laptop
elif ip == 1: #real robot
    ros_client = RosClient('127.0.0.1', 9090) #place holder

waitLock = ManualResetEventSlim(False)
ros_client.on_ready(lambda: waitLock.Set())

if not waitLock.Wait(TimeSpan.FromSeconds(5)):
    raise Exception('Unable to connect to ROS')

LOGGER.info('Connected to ROS')
# ---------- end ros ----------
connect_2 = PythonScript(ros_client=ros, connect=connect, disconnect=disconnect)  # -> out, ros_client
# ---------- connect_2: Python ----------
import logging
from System import TimeSpan
from System.Threading import ManualResetEventSlim

LOGGER = logging.getLogger('roslibpy')

if connect:
    if not ros_client.is_connected:
        LOGGER.debug('Connecting...')
        waitLock = ManualResetEventSlim(False)
        ros_client.on_ready(lambda: waitLock.Set())
        ros_client.connect()

        if not waitLock.Wait(TimeSpan.FromSeconds(5)):
            raise Exception('Unable to connect to ROS')
        LOGGER.debug('Reconnected')

if disconnect:
    if ros_client.is_connected:
        ros_client.terminate()
        LOGGER.debug('Terminated')
# ---------- end connect_2 ----------
move = Move(Geometry=pick_pt_modelled, Motion=Z)  # -> Geometry, Transform
path = PythonScript(path=panel, robot_name=robot_name)  # -> urdf_source
# ---------- path: Python ----------
import os

urdf_source = os.path.join(os.path.abspath(path), robot_name)

assert(os.path.isdir(urdf_source))
# ---------- end path ----------
pick_and_place_shingles = GhPythonScript(
    pick_pt=move.Geometry,
    safety_joints=safety_joints,
    placing_planes=geo_3,
    speed_move=speed_move,
    speed_pick_and_place=speed_pick_and_place,
    speed_safe_positions=speed_safe_positions,
    send=send)  # -> out, a; inputs pick_pt: Point3d, safety_joints: list, placing_planes: list of Plane, send: Boolean
# ---------- pick_and_place_shingles: Python ----------
################################################################################
# Imports
import compas_rrc as rrc
from compas.geometry import Frame
from compas.geometry import Point
from compas.geometry import Vector

################################################################################
# Timeouts
TIMEOUT         =    5  #[s]    avoid freezing the main thread forever in case controller (virtual or real) is not available.
TIMEOUT_LONG    =   30  #[s]    avoid freezing the main thread forever, for time consuming processes (slow motions)

################################################################################


if send:
    # Create Ros Client
    ros = rrc.RosClient()
    ros.run()
    
    # Create ABB Client
    abb = rrc.AbbClient(ros, '/rob1')
    print('Connected.')
    
    # string vlaue list of 8 strings, for custom instructions
    string_values = []
    
    # float value list of 36 floats, for custom instructions
    float_values = []
    
    # define pick position
    #old
    """
    pick_position = Frame(Point(474.34, 74.42, 3.6), Vector(-1, 0, 0), Vector(0, 1, 0))
    pick_approach = Frame(Point(474.34, 74.42, 3.6 + 100), Vector(-1, 0, 0), Vector(0, 1, 0))
    """
    
    # new
    pick_safety_joints, external_axes = safety_joints, []
    pick_position = Frame(Point(pick_pt.X, pick_pt.Y, pick_pt.Z), Vector(-1, 0, 0), Vector(0, 1, 0))
    pick_approach = Frame(Point(pick_pt.X, pick_pt.Y, pick_pt.Z + 100), Vector(-1, 0, 0), Vector(0, 1, 0))
    
    
    # define place positions
    """old
    place_positions = []
    place_position_1 = Frame(Point(0, 0, 50), Vector(-1, 0, 0), Vector(0, 1, 0))
    place_position_2 = Frame(Point(50, 0, 50), Vector(-1, 0, 0), Vector(0, 1, 0))
    place_position_3 = Frame(Point(50, 50, 50), Vector(-1, 0, 0), Vector(0, 1, 0))
    """
    
    # new
    place_positions = []
    for i, plane in enumerate(placing_planes):
        if i < 19:
            point = Point(plane.Origin.X, plane.Origin.Y, plane.Origin.Z)
            vector_x = Vector(plane.XAxis.X, plane.XAxis.Y, plane.XAxis.Z)
            vector_y = Vector(plane.YAxis.X, plane.YAxis.Y, plane.YAxis.Z)
            place_position = Frame(point, vector_x, vector_y)
            place_positions.append(place_position)
    
    # pick and place procedure
    # set tool to tVacuumSchmalz, Vacuum Gripper
    done = abb.send_and_wait(rrc.SetTool('tVacuumSchmalz'), timeout=TIMEOUT)
    
    # set wobj to wobj_plate, Building Plate
    done = abb.send_and_wait(rrc.SetWorkObject('wobj_plate'), timeout=TIMEOUT)
    
    #speed_move = 100
    #speed_pick_and_place = 20
    #speed_safe_positions = 200
    for position in place_positions:
        # pick shingle
        instruction = 'r_WS_OpenVacuumGripper'
        done = abb.send_and_wait(rrc.CustomInstruction(instruction, string_values, float_values), timeout=TIMEOUT_LONG)
        # 1. move to safety
        done = abb.send_and_wait(rrc.MoveToJoints(pick_safety_joints, external_axes, speed_safe_positions, rrc.Zone.FINE), timeout=TIMEOUT_LONG)
        # 2. move above pick
        abb.send_and_wait(rrc.MoveToFrame(pick_approach, speed_move, rrc.Zone.Z10, rrc.Motion.JOINT), timeout=TIMEOUT_LONG)
        # 3. move to pick
        abb.send_and_wait(rrc.MoveToFrame(pick_position, speed_pick_and_place, rrc.Zone.FINE, rrc.Motion.LINEAR), timeout=TIMEOUT_LONG)
        # 4. pick shingle
        instruction = 'r_WS_CloseVacuumGripper'
        done = abb.send_and_wait(rrc.CustomInstruction(instruction, string_values, float_values), timeout=TIMEOUT_LONG)
        # 5. move back to above pick
        abb.send_and_wait(rrc.MoveToFrame(pick_position, speed_pick_and_place, rrc.Zone.Z10, rrc.Motion.LINEAR), timeout=TIMEOUT_LONG)
        # 6. move back to safety
        done = abb.send_and_wait(rrc.MoveToJoints(pick_safety_joints, external_axes, speed_safe_positions, rrc.Zone.FINE), timeout=TIMEOUT_LONG)

        # place shingle
        offset_value = 100
        # 1. move above place position
        position.point[2] += offset_value
        abb.send_and_wait(rrc.MoveToFrame(position, speed_move, rrc.Zone.Z10, rrc.Motion.JOINT), timeout=TIMEOUT_LONG)
        # 2. move to place position
        position.point[2] -= offset_value
        abb.send_and_wait(rrc.MoveToFrame(position, speed_pick_and_place, rrc.Zone.FINE, rrc.Motion.LINEAR), timeout=TIMEOUT_LONG)
        # 3. place shingle
        instruction = 'r_WS_OpenVacuumGripper'
        done = abb.send_and_wait(rrc.CustomInstruction(instruction, string_values, float_values), timeout=TIMEOUT_LONG)
        # 4. move back above place position
        position.point[2] += offset_value
        abb.send_and_wait(rrc.MoveToFrame(position, speed_pick_and_place, rrc.Zone.Z10, rrc.Motion.LINEAR), timeout=TIMEOUT_LONG)

    done = abb.send_and_wait(rrc.MoveToJoints(pick_safety_joints, external_axes, speed_safe_positions, rrc.Zone.FINE), timeout=TIMEOUT_LONG)

    # End of Code
    print('Finished')

    # Close client
    ros.close()
    ros.terminate()
# ---------- end pick_and_place_shingles ----------
xy_4 = XYPlane(Origin=pick_pt)
units = ValueList({"m": 1, "mm": 1000}, selected="mm")
load = BooleanToggle(True)
robot = PythonScript(urdf_source=path, ros_client=connect_2.ros_client, scale_factor=units, load=load)  # -> out, robot
# ---------- robot: Python ----------
import os
from scriptcontext import sticky as st
import compas


from compas.robots import RobotModel
from compas.robots import LocalPackageMeshLoader
from compas_fab.ghpython import RobotArtist

from compas_fab.robots import Robot as Robot
from compas_fab.backends import RosClient


# Set high precision to import meshes defined in meters
compas.PRECISION = '12f'

# store data in component
guid = str(ghenv.Component.InstanceGuid)
robot_key = "robot_" + guid


if robot_key not in st:
    st[robot_key] = None


if load == True:
    
    model = RobotModel.from_urdf_file(os.path.join(urdf_source, 'robot_description.urdf'))
    model.load_geometry(LocalPackageMeshLoader(urdf_source, 'robot_description'))
    artist = RobotArtist(model)
    robot = Robot(model, artist, semantics = None)
    
    robot.scale(scale_factor)
    st[robot_key] = robot

robot = st[robot_key]

if robot:
    robot.client = ros_client
# ---------- end robot ----------
panel_2 = Panel(pick_and_place_shingles.out)
geo_10 = Geometry(<point referenced from the Rhino model>)
geo_11 = Geometry(<point referenced from the Rhino model>)
j5 = Slider(124, range=-360..360)
j1 = Slider(34, range=-360..360)
j2 = Slider(4, range=-360..360)
j3 = Slider(-18, range=-360..360)
j6 = Slider(31, range=-360..360)
j4 = Slider(-116, range=-360..360)
pdecon = Deconstruct(Point=geo_10)  # -> XComponent, YComponent, ZComponent
x = Number(pdecon.XComponent)
y = Number(pdecon.YComponent)
z = Number(pdecon.ZComponent)
state = ValueList({"forward_kinematics": 0, "robot_state": 1}, selected="robot_state")
button = Button()

send_frame = Button()
x_2 = Number(expr("x*1000", pdecon.XComponent))
y_2 = Number(expr("x*1000", pdecon.YComponent))
z_2 = Number(expr("x*1000", pdecon.ZComponent))
connect_3 = BooleanToggle(True)
compas_rrc = GhPythonScript(robot_name=robot_name, send=send_frame, x_coor=x, y_coor=y, z_coor=z)  # -> out; inputs x_coor: list, y_coor: list, z_coor: list
# ---------- compas_rrc: Python ----------
################################################################################
#### IMPORTS ###################################################################
from __future__ import absolute_import, division, print_function

import Rhino.Geometry as rg

from compas.geometry import Frame, Point, Vector
from compas_fab.backends.ros import RosClient
from compas_rrc import AbbClient, GetFrame, Motion, MoveToFrame, PrintText, SetAcceleration, SetMaxSpeed, SetWorkObject, SetTool, Zone
#### END OF IMPORTS ############################################################
################################################################################


################################################################################
##### GLOBALS ##################################################################
TIMEOUT         =    5  #[s]    avoid freezing the main thread forever in case controller (virtual or real) is not available.
TIMEOUT_LONG    =   30  #[s]    avoid freezing the main thread forever, for time consuming processes (slow motions)

##### END OF GLOBALS ###########################################################
################################################################################

target_frame = []
for x, y, z in zip(x_coor, y_coor, z_coor):
    # target_frame.append(Frame(Point(x, y, z), Vector(0.000, 0.000, -1.000), Vector(0.000, 1.000, 0.000)))
    target_frame.append(Frame(Point(x, y, z), Vector(-1.000, 0.000, 0.000), Vector(0.000, 1.000, 0.000)))

target_frame_name = "target_frame"

if target_frame is not None and robot_name == "abb_irb4600_60_205" or "abb_crb_15000":
    if send:
        # Create Ros Client
        ros = RosClient()
        print(ros.is_connected)
        ros.run() # new
        
        # Create ABB Client
        abb = AbbClient(ros)
        #abb.run(timeout=TIMEOUT)        #old
        print(ros.is_connected)
        print('Connected.')
        
        # Set the correct Tool TCP and Set Work Object
        """ for safe operation --avoiding mistakes-- define the properties of the tool
        in RAPID and only call/set which tool to use here."""
        if robot_name == "abb_irb4600_60_205":
            done = abb.send_and_wait(SetTool("t_RRC_Tool_Z"), timeout=TIMEOUT)
            abb.send(SetWorkObject("ob_RRC_Workplace"))
        elif robot_name == "abb_crb_15000":
            done = abb.send_and_wait(SetTool("tool0"), timeout=TIMEOUT)
            abb.send(SetWorkObject("wobj0"))
            
        #elif robot_name == "abb_crb_15000":
        #    done = abb.send_and_wait(SetTool("t_RRC_Act"), timeout=TIMEOUT)
        #    abb.send(SetWorkObject("ob_RRC_Act"))
        
        # Set Acceleration
        acc =  100 # Unit [%]
        ramp = 100 # Unit [%]
        done = abb.send_and_wait(SetAcceleration(acc, ramp), timeout=TIMEOUT)
        
        # Set Max Speed
        override = 100 # Unit [%]
        max_tcp =  500 # Unit [mm/s]
        done = abb.send_and_wait(SetMaxSpeed(override, max_tcp), timeout=TIMEOUT)
        
        # Display action sent on the TeachPendant 
        pendant_message = "Moving to position on {target_frame_name}".format(target_frame_name = target_frame_name)
        done = abb.send_and_wait(PrintText(pendant_message))
        
        # Move to Frame
        for frame in target_frame:
            current_frame = abb.send_and_wait(MoveToFrame(frame, 200, Zone.FINE, Motion.LINEAR), timeout=TIMEOUT_LONG)
            print(current_frame)
        
        # Close client
        # abb.close() # old
        # abb.terminate() # old
        ros.close() # new
        ros.terminate() # new
        
        # End of Code
        print('Finished')
        
    else:
        print("No motion command sent")
# ---------- end compas_rrc ----------
compas_rrc_2 = GhPythonScript(robot_name=robot_name, connect=connect_3, refresh=button)  # -> out; inputs refresh: Boolean
# ---------- compas_rrc_2: Python ----------
################################################################################
#### IMPORTS ###################################################################
from __future__ import absolute_import, division, print_function

import Rhino.Geometry as rg

from compas.geometry import Frame, Point
from compas_fab.backends.ros import RosClient
from compas_rrc import AbbClient, GetJoints
#### END OF IMPORTS ############################################################
################################################################################


################################################################################
##### GLOBALS ##################################################################
TIMEOUT         =    5  #[s]    avoid freezing the main thread forever in case controller (virtual or real) is not available.
TIMEOUT_LONG    =   30  #[s]    avoid freezing the main thread forever, for time consuming processes (slow motions)

##### END OF GLOBALS ###########################################################
################################################################################

import scriptcontext as sc

if robot_name == "abb_irb4600_60_205" or "abb_crb_15000":
    if connect:
        # Create Ros Client
        ros = RosClient()
        print(ros.is_connected)
        ros.run() # new
        
        # Create ABB Client
        abb = AbbClient(ros)
        #abb.run(timeout=TIMEOUT)        #old
        print(ros.is_connected)
        print('Connected.')
        
        # Get joints states
        
        # joint_states = abb.send_and_wait(GetJoints(feedback_level=1), timeout=TIMEOUT_LONG) # old
        joint_states = abb.send_and_wait(GetJoints(), timeout=TIMEOUT_LONG) #new
        
        sc.sticky['abb_state'] = joint_states
        message_abb_state = sc.sticky['abb_state']
        
        print (message_abb_state[0])
        
        # Close client
        # abb.close() # old
        # abb.terminate() # old
        ros.close() # new
        ros.terminate() # new
        
        
        # End of Code
        print('Finished')
# ---------- end compas_rrc_2 ----------

forward_kinematics = PythonScript(robot=robot.robot, j1=j1, j2=j2, j3=j3, j4=j4, j5=j5, j6=j6)  # -> configuration
# ---------- forward_kinematics: Python ----------
import math
from compas_fab.robots import Configuration

if robot:
    configuration = [j1, j2, j3, j4, j5, j6]
    configuration = [math.radians(a) for a in configuration]
# ---------- end forward_kinematics ----------
show_end_effector_frame = BooleanToggle(False)
panel_3 = Panel(compas_rrc)
show_visual = BooleanToggle(True)
show_axes = BooleanToggle(True)
panel_4 = Panel(compas_rrc_2)
visualize = PythonScript(
    robot_name=robot_name,
    robot=robot.robot,
    mode=state,
    configuration=forward_kinematics,
    robot_2=robot.robot,
    show_visual=show_visual,
    show_axes=show_axes,
    show_end_effector_frame=show_end_effector_frame,
    refresh=button)  # -> visual, axes, axes_color, ee_frame_vis, ee_color; inputs configuration: list, refresh: Boolean
# ---------- visualize: Python ----------
from System.Drawing import Color
from compas_ghpython.utilities import draw_frame
from compas_ghpython.utilities import draw_pipes
from compas_fab.robots import Configuration

from compas.geometry import Point
from compas.geometry import Vector

import scriptcontext as sc
import math as m

frames = []

size = .100
size_w = 1
radius = .001 
radius_w = .009 

red = Color.FromArgb(255, 0, 0)
green = Color.FromArgb(0, 255, 0)
blue = Color.FromArgb(0, 0, 255)

frame_colors = [red, green, blue]


def pipes_from_frame(frame, size, radius): 
    pipes = []
    for axis in [frame.xaxis, frame.yaxis, frame.zaxis]:
        pipe = {}
        pipe['points'] = [list(frame.point), list(Point(*frame.point) + Vector(*axis) * size)]
        pipe['radius'] = radius
        pipes.append(pipe)
    return pipes



if robot and len(configuration):
    if mode == 0: #forward_kinematics
        #print configuration
        configuration = Configuration.from_revolute_values(configuration)

    elif mode == 1: #robot_state

        joint_names = []
        joint_positions = []

        if robot_name == "abb_irb4600_60_205" or "abb_crb_15000":
            message_abb_state = sc.sticky['abb_state']
            print sc.sticky
            for reading in range(6):
                joint_positions.append(m.radians(message_abb_state[0][reading]))

        configuration = Configuration.from_revolute_values(joint_positions)
        
    print ('Setting robot configuration:')
    print (configuration)
    
    robot.update(configuration, visual=True, collision=False)
    
    if show_visual:
        visual = robot.artist.draw_visual()

    if show_axes:
        pipes = []
        axes_color = []
        for frame in robot.transformed_frames(configuration):
            pipes += pipes_from_frame(frame, size, radius)
            axes_color += frame_colors
        axes = draw_pipes(pipes, cap=1)
    
    
    if show_end_effector_frame:
        ee_frame = robot.forward_kinematics(configuration)
        print("End-effector", ee_frame)
        
        #Draw
        ee_pipes = pipes_from_frame(ee_frame, size, radius)
        ee_frame_vis = draw_pipes(ee_pipes, cap=1)
        ee_color = frame_colors
# ---------- end visualize ----------
geo_12 = Geometry(visualize.visual)
preview = CustomPreview(Geometry=visualize.ee_frame_vis, Shader=visualize.ee_color)
preview_2 = CustomPreview(Geometry=visualize.axes, Shader=visualize.axes_color)
transform = Transform(Geometry=geo_12)
